# Grasshopper definition RDTE.gh (Grasshopper 1.0.7)

hb_building_programs = HBBuildingPrograms({"LargeOffice", "MediumOffice", "SmallOffice", "MidriseApartment", "HighriseApartment", "Retail", "StripMall", "PrimarySchool", "SecondarySchool", "SmallHotel", "LargeHotel", "Hospital", "Outpatient", "Laboratory", "Warehouse", "SuperMarket", "FullServiceRestaurant", "QuickServiceRestaurant", "Courthouse", "LargeDataCenterHighITE", "LargeDataCenterLowITE", "SmallDataCenterHighITE", "SmallDataCenterLowITE"}, selected="LargeOffice")
hb_climate_zones = HBClimateZones({"1 - Very Hot": "1", "2 - Hot": "2", "3 - Warm": "3", "4 - Mixed": "4", "5 - Cool": "5", "6 - Cold": "6", "7 - Very Cold": "7", "8 - Subarctic": "8"}, selected="5 - Cool")
unit_z = UnitZ(Factor="5")
unit_z_2 = UnitZ(Factor="5")
constrsetclimate = HBConstructionSetByClimate(climate_zone=hb_climate_zones)  # -> constr_set; plug-in component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
searchprog = HBSearchPrograms(bldg_prog=hb_building_programs)  # -> room_prog; plug-in component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
unit_z_3 = UnitZ(Factor="5")
geometry = Geometry([<brep referenced from the Rhino model> x5])
move = Move(Geometry=geometry, Motion=unit_z)  # -> Geometry, Transform
move_2 = Move(Geometry=move.Geometry, Motion=unit_z_2)  # -> Geometry, Transform
list_item = ListItem(List=move_2.Geometry, Index=0, Wrap=True)
room2d = DFRoom2D(geo=flatten(move.Geometry), flr_to_ceiling="5", program=searchprog, constr_set=constrsetclimate)  # -> out, room2d; plug-in component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
move_3 = Move(Geometry=list_item, Motion=unit_z_3)  # -> Geometry, Transform
room2d_2 = DFRoom2D(geo=flatten(geometry), flr_to_ceiling="5", program=searchprog, constr_set=constrsetclimate)  # -> out, room2d; plug-in component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
move_4 = Move(Geometry=move_3.Geometry, Motion=unit_z_3)  # -> Geometry, Transform
boolean_toggle = BooleanToggle(True)
room2d_3 = DFRoom2D(geo=flatten(move_2.Geometry), flr_to_ceiling="5", program=searchprog, constr_set=constrsetclimate)  # -> out, room2d; plug-in component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
boolean_toggle_2 = BooleanToggle(True)
boolean_toggle_3 = BooleanToggle(True)
room2d_4 = DFRoom2D(geo=flatten(move_3.Geometry), flr_to_ceiling="5", program=searchprog, constr_set=constrsetclimate)  # -> out, room2d; plug-in component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
introom2d = DFIntersectRoom2Ds(room2ds=flatten(room2d.room2d), run=boolean_toggle)  # -> int_room2ds; plug-in component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
introom2d_2 = DFIntersectRoom2Ds(room2ds=flatten(room2d_2.room2d), run=boolean_toggle_2)  # -> int_room2ds; plug-in component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
room2d_5 = DFRoom2D(geo=flatten(move_4.Geometry), flr_to_ceiling="5", program=searchprog, constr_set=constrsetclimate)  # -> out, room2d; plug-in component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
boolean_toggle_4 = BooleanToggle(True)
introom2d_3 = DFIntersectRoom2Ds(room2ds=flatten(room2d_3.room2d), run=boolean_toggle_3)  # -> int_room2ds; plug-in component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
panel = Panel("""0.5
0.45
0.6
0.7""")
panel_2 = Panel("""0.5
0.45
0.6
0.7""")
boolean_toggle_5 = BooleanToggle(True)
solveadj2d = DFSolveAdjacency(room2ds=flatten(introom2d), run=boolean_toggle)  # -> out, adj_room2ds; plug-in component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
solveadj2d_2 = DFSolveAdjacency(room2ds=flatten(introom2d_2), run=boolean_toggle_2)  # -> out, adj_room2ds; plug-in component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
panel_3 = Panel("""0.5
0.45
0.6
0.7""")
introom2d_4 = DFIntersectRoom2Ds(room2ds=flatten(room2d_4.room2d), run=boolean_toggle_4)  # -> int_room2ds; plug-in component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
explode_tree = ExplodeTree(Data=graft(panel))  # -> Branch0, Branch1, Branch2, Branch3
explode_tree_2 = ExplodeTree(Data=graft(panel_2))  # -> Branch0, Branch1, Branch2, Branch3
solveadj2d_3 = DFSolveAdjacency(room2ds=flatten(introom2d_3), run=boolean_toggle_3)  # -> out, adj_room2ds; plug-in component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
introom2d_5 = DFIntersectRoom2Ds(room2ds=flatten(room2d_5.room2d), run=boolean_toggle_5)  # -> int_room2ds; plug-in component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
explode_tree_3 = ExplodeTree(Data=graft(panel_3))  # -> Branch0, Branch1, Branch2, Branch3
panel_4 = Panel("""0.5
0.45
0.6
0.7""")
facparam = HBFacadeParameters(north=explode_tree.Branch0, east=explode_tree.Branch1, south=explode_tree.Branch2, west=explode_tree.Branch3)  # -> fac_par; plug-in component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
facparam_2 = HBFacadeParameters(north=explode_tree_2.Branch0, east=explode_tree_2.Branch1, south=explode_tree_2.Branch2, west=explode_tree_2.Branch3)  # -> fac_par; plug-in component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
panel_5 = Panel("""0.5
0.45
0.6
0.7""")
solveadj2d_4 = DFSolveAdjacency(room2ds=flatten(introom2d_4), run=boolean_toggle_4)  # -> out, adj_room2ds; plug-in component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
facparam_3 = HBFacadeParameters(north=explode_tree_3.Branch0, east=explode_tree_3.Branch1, south=explode_tree_3.Branch2, west=explode_tree_3.Branch3)  # -> fac_par; plug-in component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
solveadj2d_5 = DFSolveAdjacency(room2ds=flatten(introom2d_5), run=boolean_toggle_5)  # -> out, adj_room2ds; plug-in component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
explode_tree_4 = ExplodeTree(Data=graft(panel_4))  # -> Branch0, Branch1, Branch2, Branch3
repeatingratiopar = DFRepeatingWindowRatioParameters(ratio=facparam)  # -> win_par; plug-in component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
repeatingratiopar_2 = DFRepeatingWindowRatioParameters(ratio=facparam_2)  # -> win_par; plug-in component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
explode_tree_5 = ExplodeTree(Data=graft(panel_5))  # -> Branch0, Branch1, Branch2, Branch3
repeatingratiopar_3 = DFRepeatingWindowRatioParameters(ratio=facparam_3)  # -> win_par; plug-in component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
facparam_4 = HBFacadeParameters(north=explode_tree_4.Branch0, east=explode_tree_4.Branch1, south=explode_tree_4.Branch2, west=explode_tree_4.Branch3)  # -> fac_par; plug-in component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
facparam_5 = HBFacadeParameters(north=explode_tree_5.Branch0, east=explode_tree_5.Branch1, south=explode_tree_5.Branch2, west=explode_tree_5.Branch3)  # -> fac_par; plug-in component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
applyfacadepar = DFApplyFacadeParameters(df_obj=flatten(solveadj2d.adj_room2ds), win_par=repeatingratiopar)  # -> out, df_obj; plug-in component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
applyfacadepar_2 = DFApplyFacadeParameters(df_obj=flatten(solveadj2d_2.adj_room2ds), win_par=repeatingratiopar_2)  # -> out, df_obj; plug-in component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
repeatingratiopar_4 = DFRepeatingWindowRatioParameters(ratio=facparam_4)  # -> win_par; plug-in component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
applyfacadepar_3 = DFApplyFacadeParameters(df_obj=flatten(solveadj2d_3.adj_room2ds), win_par=repeatingratiopar_3)  # -> out, df_obj; plug-in component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
repeatingratiopar_5 = DFRepeatingWindowRatioParameters(ratio=facparam_5)  # -> win_par; plug-in component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
applyfacadepar_4 = DFApplyFacadeParameters(df_obj=flatten(solveadj2d_4.adj_room2ds), win_par=repeatingratiopar_4)  # -> out, df_obj; plug-in component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
setgrndtop = DFSetGroundTop(df_obj=flatten(applyfacadepar_2.df_obj), grnd_contact=Toggle(True), top_exposed=Toggle(False))  # -> out, df_obj; plug-in component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
setgrndtop_2 = DFSetGroundTop(df_obj=flatten(applyfacadepar_3.df_obj), grnd_contact=Toggle(False), top_exposed=Toggle(True))  # -> out, df_obj; plug-in component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
applyfacadepar_5 = DFApplyFacadeParameters(df_obj=flatten(solveadj2d_5.adj_room2ds), win_par=repeatingratiopar_5)  # -> out, df_obj; plug-in component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
story = DFStory(room2ds=flatten(applyfacadepar.df_obj))  # -> out, story; plug-in component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
story_2 = DFStory(room2ds=flatten(setgrndtop_2.df_obj))  # -> out, story; plug-in component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
setgrndtop_3 = DFSetGroundTop(df_obj=flatten(applyfacadepar_4.df_obj), grnd_contact=Toggle(False), top_exposed=Toggle(True))  # -> out, df_obj; plug-in component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
story_3 = DFStory(room2ds=flatten(setgrndtop.df_obj))  # -> out, story; plug-in component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
setgrndtop_4 = DFSetGroundTop(df_obj=flatten(applyfacadepar_5.df_obj), grnd_contact=Toggle(False), top_exposed=Toggle(True))  # -> out, df_obj; plug-in component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
story_4 = DFStory(room2ds=flatten(setgrndtop_3.df_obj))  # -> out, story; plug-in component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
story_5 = DFStory(room2ds=flatten(setgrndtop_4.df_obj))  # -> out, story; plug-in component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
buildingstories = DFBuildingFromStories(stories=[story_3.story, story.story, story_2.story, story_4.story, story_5.story])  # -> out, building; plug-in component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
model = DFModel(buildings=flatten(buildingstories.building))  # -> out, model; plug-in component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
dumpobjects = DFDumpObjects(
    df_objs=flatten(model.model),
    name="core_perim_tests",
    folder="D:\__A1_LBT_DEV\dragonfly-doe2\assets\reference_dfm",
    indent="4",
    dump=Toggle(False))  # -> out, df_file; plug-in component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
vizall = DFVisualizeAll(df_objs=flatten(model.model))  # -> geo; plug-in component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
boolean_toggle_6 = BooleanToggle(True)
tohoneybee = DFModelToHoneybee(model=model.model, use_multiplier=boolean_toggle_6, run=boolean_toggle_6)  # -> out, hb_models; plug-in component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
vizbytype = HBVisualizeByType(hb_objs=tohoneybee.hb_models)  # -> walls, interior_walls, roofs, ceilings, exterior_floors, interior_floors, air_walls, apertures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; plug-in component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
