# Grasshopper definition orientation_ts.gh (Grasshopper 1.0.7)
# plug-ins: Pufferfish

geometry = Geometry(<brep referenced from the Rhino model>)
point = Point(Point(0, 0, 0))
geometry_2 = Geometry([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])
point_2 = Point(Point(1.931207027, 1.916623509, 0))
skeleton = HBStraightSkeleton(floor_geo=geometry, offset=Slider(5, range=0..10))  # -> polyskel, perim_poly, core_poly; plug-in component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
move_to_point = MoveToPoint(Geometry=geometry_2, PointA=point, PointB=point_2)  # -> Moved, Vector, Transform
boundary_surfaces = BoundarySurfaces(Edges=move_to_point.Moved)
merge = Merge(Data1=skeleton.perim_poly, Data2=skeleton.core_poly)
unit_z = UnitZ(Factor="3.048")
move = Move(Geometry=merge, Motion=unit_z)  # -> Geometry, Transform
room2d = DFRoom2D(geo=flatten(move.Geometry), flr_to_ceiling="3.048")  # -> out, room2d; plug-in component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
room2d_2 = DFRoom2D(geo=flatten(merge), flr_to_ceiling="3.048")  # -> out, room2d; plug-in component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
boolean_toggle = BooleanToggle(True)
boolean_toggle_2 = BooleanToggle(True)
hb_climate_zones = HBClimateZones({"1 - Very Hot": "1", "2 - Hot": "2", "3 - Warm": "3", "4 - Mixed": "4", "5 - Cool": "5", "6 - Cold": "6", "7 - Very Cold": "7", "8 - Subarctic": "8"}, selected="5 - Cool")
introom2d = DFIntersectRoom2Ds(room2ds=flatten(room2d.room2d), run=boolean_toggle_2)  # -> int_room2ds; plug-in component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
introom2d_2 = DFIntersectRoom2Ds(room2ds=flatten(room2d_2.room2d), run=boolean_toggle)  # -> int_room2ds; plug-in component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
constrsetclimate = HBConstructionSetByClimate(climate_zone=hb_climate_zones)  # -> constr_set; plug-in component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
solveadj2d = DFSolveAdjacency(room2ds=flatten(introom2d), run=boolean_toggle_2)  # -> out, adj_room2ds; plug-in component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
solveadj2d_2 = DFSolveAdjacency(room2ds=flatten(introom2d_2), run=boolean_toggle)  # -> out, adj_room2ds; plug-in component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
story = DFStory(room2ds=flatten(solveadj2d.adj_room2ds), constr_set=constrsetclimate)  # -> out, story; plug-in component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
story_2 = DFStory(room2ds=flatten(solveadj2d_2.adj_room2ds), constr_set=constrsetclimate)  # -> out, story; plug-in component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
setgrndtop = DFSetGroundTop(df_obj=flatten(story.story), grnd_contact=Toggle(False), top_exposed=Toggle(True))  # -> out, df_obj; plug-in component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
setgrndtop_2 = DFSetGroundTop(df_obj=flatten(story_2.story), grnd_contact=Toggle(True), top_exposed=Toggle(False))  # -> out, df_obj; plug-in component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
repeatingratiopar = DFRepeatingWindowRatioParameters(ratio=".4", win_height="1.525014984", sill_height="0.947418984", horiz_separ="20")  # -> win_par; plug-in component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
applyfacadepar = DFApplyFacadeParameters(df_obj=flatten([setgrndtop.df_obj, setgrndtop_2.df_obj]), win_par=repeatingratiopar)  # -> out, df_obj; plug-in component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
buildingstories = DFBuildingFromStories(stories=applyfacadepar.df_obj)  # -> out, building; plug-in component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
model = DFModel(buildings=flatten(buildingstories.building))  # -> out, model; plug-in component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
dumpobjects = DFDumpObjects(
    df_objs=flatten(model.model),
    name="show_and_tell",
    folder="D:\__A1_LBT_DEV\dragonfly-doe2\assets\reference_dfm",
    indent="4",
    dump=Toggle(False))  # -> out, df_file; plug-in component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
tohoneybee = DFModelToHoneybee(model=model.model, run=Toggle(True))  # -> out, hb_models; plug-in component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
vizbytype = HBVisualizeByType(hb_objs=tohoneybee.hb_models)  # -> walls, interior_walls, roofs, ceilings, exterior_floors, interior_floors, air_walls, apertures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; plug-in component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
